# Grasshopper definition testFile.gh (Grasshopper 0.9.76)
# plug-ins: Python Interpreter, VirtualWindTunnel

brep = Brep(<brep referenced from the Rhino model>)
xz = XZPlane(Origin=Point(-0.0485980799, -4.042677826, 0))
domain = Domain(
    Geometry=brep,
    Directory="C:\OF2\",
    Mode=0,
    BaseMesh=Slider(50, range=0..100),
    RAM=Slider(9187, range=0..16000),
    CPUs=Slider(1, range=1..8),
    Run=Toggle(False))  # -> Out, Domain, Cyl
clean = Clean(Dir="C:\OF2\", Run=Button())
c_script = CSharpScript(b=brep, p=xz)  # -> out, B, A; inputs b: list of Brep, p: Plane
# ---------- c_script: C# ----------
    double pj = 0;
    A = FindFacades(p, b, out pj);
    B = pj;
# ---------- c_script: C# additional code ----------
  static List<Brep> FindFacades(Plane plane, List<Brep> volumes, out double projectedAreaTotal)
  {
    List<Brep> Facades = new List<Brep>();

    List<double> projectedAreas = new List<double>();
    foreach (Brep b in volumes)
    {
      for (int i = 0; i < b.Faces.Count; i++)
      {
        Vector3d vSurf = b.Faces[i].NormalAt(0.5, 0.5);
        double dot = plane.ZAxis * vSurf;
        if (dot < 0.1) continue;


        Brep face = b.Faces[i].DuplicateFace(false);
        //Print(dot + "");
        Facades.Add(face);
        
        Vector3d cross = Vector3d.CrossProduct(plane.ZAxis, vSurf);
        double norm = cross.Length;
        double angle = Math.Atan2(norm, dot);

        //Print((angle * 180 / Math.PI) + "");

        double projectedArea = face.GetArea() * Math.Cos(angle);

        projectedAreas.Add(projectedArea);
        //Print(projectedArea + "");
      }
    }
    projectedAreaTotal = projectedAreas.Sum(x => x);

    return Facades;
  }
# ---------- end c_script ----------
panel = Panel(c_script.B)
c_script_2 = CSharpScript(b=brep)  # -> out, B, A; inputs b: Box; disabled
# ---------- c_script_2: C# ----------
    B = b.GetCorners();
# ---------- end c_script_2 ----------
python = PythonScript()  # -> out, a, b, c, d, e, f
# ---------- python: Python ----------
a=x.BBox
b=x.centerGroundBBox
c=x.BBox.Min
d=x.BBox.Max
e=x.dimY
f=x.newBoxDomain.GetCorners
# ---------- end python ----------
mesh = Mesh(Accuracy=Slider(3, range=0..10), Run=Toggle(False))  # -> Out, Domain
panel_2 = Panel(python.b)
panel_3 = Panel(python.f)
panel_4 = Panel(python.a)
panel_5 = Panel(python.c)
panel_6 = Panel(mesh.Out)
simulation = Simulation(
    Iterations=Slider(1000, range=0..1000),
    WriteInterval=Slider(20, range=0..100),
    KeepTimeSteps=Slider(5, range=0..10),
    Run=Toggle(False))
